# Grasshopper definition 01_GlideReflection.gh (Grasshopper 1.0.8)

sqgrid = Square(Plane=PlaneXY(0, 0, 0), Size="30", ExtentX="10", ExtentY="10")  # -> Cells, Points

# ---- group: Create horizontal divider
explode = Explode(Curve=sqgrid.Cells, Recursive=True)  # -> Segments, Vertices
dispatch = Dispatch(List=explode.Segments, DispatchPattern=[True, False])  # -> ListA, ListB
midpt = CurveMiddle(Curve=dispatch.ListB)
item = ListItem(List=dispatch.ListA, Index=0, Wrap=True)  # -> Item, Item1
flip = FlipCurve(Curve=item.Item)  # -> Curve, Flag
pline = PolyLine(Vertices=midpt, Closed=False)
merge = Merge(Data1=flip.Curve, Data2=item.Item1)
weave = Weave(Pattern=[0, 1], Stream0=merge, Stream1=pline, NullGaps=False)

# ----
trim = TrimTree(Tree=weave, Depth=1)
tstat = TreeStatistics(Tree=trim)  # -> Paths, Length, Count
dispatch_2 = Dispatch(List=tstat.Paths, DispatchPattern=[True, False])  # -> ListA, ListB
branch = TreeBranch(Tree=trim, Path=dispatch_2.ListA, MaintainPaths=True)
branch_2 = TreeBranch(Tree=trim, Path=dispatch_2.ListB, MaintainPaths=True)
partition = PartitionList(List=branch, Size="3")
partition_2 = PartitionList(List=branch_2, Size="3")
item_2 = ListItem(List=partition, Index=0, Wrap=True)  # -> Item, Item1, Item2
line = Line(item_2.Item)
midpt_2 = CurveMiddle(Curve=item_2.Item1)
end = EndPoints(Curve=item_2.Item2)  # -> Start, End
end_2 = EndPoints(Curve=item_2.Item)  # -> Start, End
end_3 = EndPoints(Curve=line)  # -> Start, End
end_4 = EndPoints(Curve=item_2.Item1)  # -> Start, End
midpt_3 = CurveMiddle(Curve=item_2.Item1)
end_5 = EndPoints(Curve=item_2.Item2)  # -> Start, End
ln = Line(StartPoint=end_2.End, EndPoint=midpt_2)
ln_2 = Line(StartPoint=midpt_2, EndPoint=end_2.Start)
ln_3 = Line(StartPoint=end.End, EndPoint=midpt_2)
ln_4 = Line(StartPoint=midpt_2, EndPoint=end.Start)
merge_2 = Merge(Data1=item_2.Item, Data2=ln, Data3=ln_2)
merge_3 = Merge(Data1=item_2.Item2, Data2=ln_3, Data3=ln_4)
merge_4 = Merge(Data1=end_3.End, Data2=end_4.End, Data3=midpt_3)
merge_5 = Merge(Data1=midpt_3, Data2=end_4.Start, Data3=end_3.Start)
merge_6 = Merge(Data1=end_4.End, Data2=end_5.End, Data3=midpt_3)
merge_7 = Merge(Data1=midpt_3, Data2=end_5.Start, Data3=end_4.Start)

pline_2 = PolyLine(Vertices=merge_4, Closed=invert(False))
pline_3 = PolyLine(Vertices=merge_6, Closed=invert(False))
pline_4 = PolyLine(Vertices=merge_5, Closed=invert(False))
pline_5 = PolyLine(Vertices=merge_7, Closed=invert(False))
join = JoinCurves(Curves=merge_2, Preserve=False)
join_2 = JoinCurves(Curves=merge_3, Preserve=False)
