# Grasshopper definition 03_Hubermann.gh (Grasshopper 1.0.8)
# plug-ins: eleFront

panel = Panel("crv;outer_circle")
number_slider = Slider(15, range=10..20)
xy = XYPlane(Origin=Point(0, 0, 0))
X = UnitX(Factor=1)
number_slider_2 = Slider(17, range=0..50)

cir = Circle(Plane=PlaneXY(0, 0, 0), Radius="130")
cir_2 = Circle(Plane=PlaneXY(0, 0, 0), Radius="140")
cir_3 = Circle(Plane=PlaneXY(0, 0, 0), Radius="150")

crv_mddle_circle = EleFrontDataDescription(cir_2, ShiftDepth=0, isNameSet=True)
crv_outer_circle = EleFrontDataDescription(cir_3, ShiftDepth=0, isNameSet=True)
crv_inner_circle = EleFrontDataDescription(cir, ShiftDepth=0, isNameSet=True)
line = LineSDL(Start=xy, Direction=X, Length="150")
multiplication = Multiplication(A=number_slider_2, B=2)
arrpolar = PolarArray(Geometry=line, Plane=PlaneXY(0, 0, 0), Count=multiplication, Angle=6.283185307)  # -> Geometry, Transform
crv_mddle_circle_2 = EleFrontDataDescription(crv_mddle_circle, ShiftDepth=0, isNameSet=False)
crv_inner_circle_2 = EleFrontDataDescription(crv_inner_circle, ShiftDepth=0, isNameSet=False)
crv_outer_circle_2 = EleFrontDataDescription(crv_outer_circle, ShiftDepth=0, isNameSet=False)
dispatch = Dispatch(List=arrpolar.Geometry, DispatchPattern=[True, False])  # -> ListA, ListB
entwine = Entwine(Branch00=crv_inner_circle_2, Branch01=crv_outer_circle_2, FlattenInputs=True)
arrpolar_2 = PolarArray(Geometry=line, Plane=PlaneXY(0, 0, 0), Count=number_slider_2, Angle=6.283185307)  # -> Geometry, Transform
crv_inner_outer_circle = EleFrontDataDescription(entwine, ShiftDepth=0, isNameSet=True)
line_end_constraint = EleFrontDataDescription(arrpolar_2.Geometry, ShiftDepth=0, isNameSet=True)
crv_mddle_circle_3 = EleFrontDataDescription(crv_mddle_circle, ShiftDepth=0, isNameSet=False)
transform = EleFrontDataDescription(arrpolar_2.Transform, ShiftDepth=0, isNameSet=False)
crv = Curve(dispatch.ListB)
transform_2 = EleFrontDataDescription(transform, ShiftDepth=0, isNameSet=False)
line_end_constraint_2 = EleFrontDataDescription(line_end_constraint, ShiftDepth=0, isNameSet=False)
crv_inner_outer_circle_2 = EleFrontDataDescription(crv_inner_outer_circle, ShiftDepth=0, isNameSet=False)
crvprox = CurveProximity(CurveA=crv_inner_outer_circle_2, CurveB=line_end_constraint_2)  # -> PointA, PointB, Distance
crvprox_2 = CurveProximity(CurveA=crv_mddle_circle_3, CurveB=crv)  # -> PointA, PointB, Distance
