# Grasshopper definition 04_radialfolding.gh (Grasshopper 1.0.8)
# plug-ins: eleFront

number_slider = Slider(17, range=0..200)
number_slider_2 = Slider(115, range=0..200)
subtraction = Subtraction(A=number_slider_2, B=number_slider)
X = UnitX(Factor=1)
pt = ConstructPoint(XCoordinate=number_slider, YCoordinate=0, ZCoordinate=0)

cir = Circle(Plane=PlaneXY(0, 0, 0), Radius=number_slider_2)
line = LineSDL(Start=pt, Direction=X, Length=subtraction)
cir_2 = Circle(Plane=PlaneXY(0, 0, 0), Radius=number_slider)

panel = Panel("2")
arrpolar = PolarArray(Geometry=line, Plane=PlaneXY(0, 0, 0), Count=Slider(10, range=4..30), Angle=6.283185307)  # -> Geometry, Transform
graft = GraftTree(Tree=arrpolar.Geometry, IncludeEmptyLists=True, IncludeNullItems=True)
merge = Merge(Data1=graft, Data2=graft)  # -> flatten(Result)
crv_base_radial_line = EleFrontDataDescription(merge, ShiftDepth=0, isNameSet=True)
crv_base_radial_line_2 = EleFrontDataDescription(crv_base_radial_line, ShiftDepth=0, isNameSet=False)
shift = ShiftList(List=crv_base_radial_line_2, Shift="-1", Wrap=True)
partition = PartitionList(List=shift, Size="2")
dash = DashPattern(Curve=partition, Pattern="2")  # -> simplify(Dashes), simplify(Gaps)
tstat = TreeStatistics(Tree=dash.Dashes)  # -> Paths, Length, Count
dispatch = Dispatch(List=tstat.Paths, DispatchPattern=[True, False])  # -> ListA, ListB
item = ListItem(List=tstat.Length, Index=0, Wrap=True)
branch = TreeBranch(Tree=dash.Dashes, Path=dispatch.ListA, MaintainPaths=True)
branch_2 = TreeBranch(Tree=dash.Dashes, Path=dispatch.ListB, MaintainPaths=True)
subtraction_2 = Subtraction(A=item, B=1)
merge_2 = Merge(Data1="0", Data2=subtraction_2)  # -> flatten(Result)
cull_i = CullIndex(List=branch_2, Indices=merge_2, Wrap=True)
item_2 = ListItem(List=branch_2, Index=merge_2, Wrap=True)
item_3 = ListItem(List=item_2, Index=0, Wrap=True)  # -> Item, Item1
path_mapper = PathMapper(cull_i, source="{A;B;C}(i)", target="{A;B;i}")
merge_3 = Merge(Data1=path_mapper, Data2=path_mapper)
trim = TrimTree(Tree=merge_3, Depth=1)
merge_4 = Merge(Data1=item_3.Item, Data2=trim, Data3=item_3.Item1)
graft_2 = GraftTree(Tree=branch, IncludeEmptyLists=True, IncludeNullItems=True)  # -> simplify(Tree)
partition_2 = PartitionList(List=merge_4, Size="2")  # -> simplify(Chunks)
item_4 = ListItem(List=partition_2, Index=0, Wrap=True)  # -> Item, Item1
merge_5 = Merge(Data1=item_4.Item, Data2=graft_2, Data3=item_4.Item1, Data4=item_4.Item1)
crv_dotted_curves_grouped = EleFrontDataDescription(merge_5, ShiftDepth=0, isNameSet=True)
crv_dotted_curves_grouped_2 = EleFrontDataDescription(crv_dotted_curves_grouped, ShiftDepth=0, isNameSet=False)
midpt = CurveMiddle(Curve=crv_dotted_curves_grouped_2)
pline = PolyLine(Vertices=midpt, Closed=False)
fillet = Fillet(Curve=pline, Radius=Slider(0.4, range=0..10))
